# Dynamo graph ExtractFamilyDataFromDirectory.dyn (Dynamo 2.3.0.5885)

# group: DESIGN
# note: DESIGN
# note: USE:
# FOR THE BACK-END FUNCTIONALITY

# group: <PROJECT NO.> <PROJECT NAME>
# note: CREATED BY: <SUMMON IDEA>
# CREATED: <20210817>
# VERSION <0.1>
# LAST EDITED: <20210817>
# DYNAMO VERSION: <Dynamo 2.3>
# PACKAGES:
# <PACKAGES>
# NOTES:
# <NOTES>
# DYNAMO GRAPHIC STANDARD
# CREATED BY: VLADIMIR ONDEJCIK
# WHITE ARKITEKTER AB - 2016

# group: DESIGNER'S GUIDELINES
# note: DESIGNER'S GUIDELINES
# 1. DIVIDE THE DYNAMO DEFINITION INTO THE USER INTERFACE AND THE BACK-END
# 2. BUILD THE DEFINITION WITH SMALL BLOCKS
# 3. BLOCKS SHOULD ALWAYS HAVE INPUT/OUTPUT
# 4. RENAME INPUT/OUTPUT CONTAINERS TO DATA THEY CARRY
# 5. COLOR-CODE BLOCKS ACCORDING TO THE TEMPLATE

# group: USER INTERFACE
# note: INPUT + CONTROL

# group: DESIGN
# note: BACK-END FUNCTIONALITY

# group: CONTROL
# note: CONTROL
# note: USE:
# FOR THE USER INPUT (SUCH AS SLIDERS,
#  NUMBERS, ....)

# group: INPUT
# note: INPUT
# note: USE:
# FOR THE INCOMMING REFFERENCES
# (FILE PATHS, GEOMETRIES ...                     )

# group: TO REVIT
# note: TO REVIT
# note: USE:
# FOR BLOCKS THAT EXPORT THE GEOMETRY AND PARAMETERS TO REVIT

# group: MONITOR
# note: MONITOR
# note: USE:
# FOR IMPORTANT WATCH NODES

# group: ANNOTATION
# note: ANNOTATION
# note: USE:
# FOR COMMENTS

# group: WIP
# note: WIP
# note: USE:
# FOR "WORK IN PROGRESS"

# group: INPUT DIRECTORIES
input_rfa_families = Directory("D:\Xavier\SUMMONIDEA\BLOGGING\summon-family-browser\src\input_families")  # graph input
output_fbx_families = Directory("D:\Xavier\SUMMONIDEA\BLOGGING\summon-family-browser\src\output_families")  # graph input
output_json = Directory("D:\Xavier\SUMMONIDEA\BLOGGING\summon-family-browser\src")  # graph input

fromPath = DirectoryObject(path=input_rfa_families)  # "Directory.FromPath"
code_block = CodeBlock { "*.rfa"; }
boolean = BoolSelector(true)
getDirectoryContents = FileSystem.GetDirectoryContents(directory=fromPath, searchString=code_block, includeSubdirectories=boolean)
string_from_object = FromObject(obj=getDirectoryContents.files)
flatten = List.Flatten(list=string_from_object)
code_block_2 = CodeBlock(f=flatten) { f[2]; }
fileName = FileSystem.FileName(path=getDirectoryContents.files)

# group: Extraction
export_fbx_and_family_parameters = Python(IN[0]=flatten, IN[1]=output_fbx_families, IN[2]=fileName, IN[3]=output_json)
# ---------- export_fbx_and_family_parameters.python (223 lines) ----------
import clr
clr.AddReference('ProtoGeometry')
from Autodesk.DesignScript.Geometry import *

# Import RevitAPI
clr.AddReference("RevitAPI")
import Autodesk
from Autodesk.Revit.DB import *
from Autodesk.Revit.Attributes import*

clr.AddReference("RevitAPIUI")
from  Autodesk.Revit.UI import *

# Import DocumentManager and TransactionManager
clr.AddReference("RevitServices")
import RevitServices
from RevitServices.Persistence import DocumentManager
from RevitServices.Transactions import TransactionManager

from System.Collections.Generic import *

# Import Revit Nodes
clr.AddReference("RevitNodes")
import Revit
clr.ImportExtensions(Revit.Elements)
clr.ImportExtensions(Revit.GeometryConversion)

# Import python library
import sys
pyt_path = r'C:\Program Files (x86)\IronPython 2.7\Lib'
sys.path.append(pyt_path)
import os
import json

tOptions = TransactWithCentralOptions()

doc = DocumentManager.Instance.CurrentDBDocument
uiapp = DocumentManager.Instance.CurrentUIApplication
app = uiapp.Application
#uidoc = DocumentManager.Instance.CurrentUIApplication.ActiveUIDocument

if isinstance(IN[0], list):
	file = IN[0]
	filename = IN[2]
else:
	file = [IN[0]]
	filename = [IN[2]]

exportPath = IN[1]
jsonexportPath = IN[3]

newdocpath = []
types, params, paramValues = [], [], []

openConfig = WorksetConfiguration(WorksetConfigurationOption.OpenAllWorksets)
oOptions = OpenOptions()
oOptions.DetachFromCentralOption = DetachFromCentralOption.DetachAndDiscardWorksets
oOptions.Audit = False
oOptions.SetOpenWorksetsConfiguration(openConfig)

worksharingOptions = WorksharingSaveAsOptions()
worksharingOptions.SaveAsCentral = False

SaveOptions = SaveAsOptions()
SaveOptions.MaximumBackups = 1
SaveOptions.OverwriteExistingFile = True

famLib = {}
famLib['families'] = []

#TransactionManager.Instance.ForceCloseTransaction()

try:
	for files,filenames in zip(file,filename):
		modelpath = FilePath(files)
		newdoc = app.OpenDocumentFile(modelpath, oOptions)
	
		collector = Autodesk.Revit.DB.FilteredElementCollector(newdoc)
		docViews = collector.OfClass(Autodesk.Revit.DB.View3D).ToElements()
		
		viewIds = []
		for v in docViews:
			if v.CanBePrinted == True:
				viewIds.append(v.Id)
		
		##EXPORT FBX
		viewSetExport = ViewSet()
		viewSetExport.Insert(docViews[0])
		exportFBX = newdoc.Export(exportPath, newdoc.Title, viewSetExport, FBXExportOptions())
		
		##EXPORT DWG
		#viewListExport = List[Autodesk.Revit.DB.ElementId]()
		#viewListExport.Add(docViews[0].Id)
		#exportDWG = newdoc.Export(exportPath, newdoc.Title, viewListExport, DWGExportOptions())
		
		##EXPORT VIEWS AS IMAGES

		# image export options constructor
		ieo = ImageExportOptions()
		# export range (exporting amount of view(s))
		ieo.ExportRange = ExportRange.SetOfViews
		ieo.SetViewsAndSheets(viewIds)
		# filepath
		ieo.FilePath = exportPath + '\\' + newdoc.Title
		# File type for exported HLR and wireframe views
		ieo.HLRandWFViewsFileType = ImageFileType.PNG
		# image resolution
		ieo.ImageResolution = ImageResolution.DPI_300
		# fit direction
		ieo.FitDirection = FitDirectionType.Horizontal
		# pixelsize
		ieo.PixelSize = 600
		# file type for exported shadow views
		ieo.ShadowViewsFileType = ImageFileType.PNG
		# zoom type
		ieo.ZoomType = ZoomFitType.FitToPage
		# export image
		newdoc.ExportImage(ieo)
		
		famManager = newdoc.FamilyManager
		
		famParams = newdoc.FamilyManager.GetParameters()
		params.append([p.Definition.Name for p in famParams])
		
		famTypes = newdoc.FamilyManager.Types
		types.append(famTypes)
		
		famTypeParamValues = []
		
		famLib['families'].append({
			'family_path': files,
			'family_name': newdoc.Title,
			'types': [],
			
		})		

		for famType in famTypes:
			tp = []
			famLib['families'][-1]['types'].append({
				'type_name': famType.Name,
				'parameters': [],
			})
			#fam = famLib['families'][-1]
			#fam['types'].append(famType.Name)
			
			for famParam in famParams:
				if famParam.StorageType == StorageType.Double:
					tp.append(famType.AsDouble(famParam))
					#famLib['families'][-1]['types'][-1]['parameters'][-1][famParam.Definition.Name] = famType.AsDouble(famParam)
					famLib['families'][-1]['types'][-1]['parameters'].append({
						'parameter_name': famParam.Definition.Name,
						'parameter_group': LabelUtils.GetLabelFor(famParam.Definition.ParameterGroup),
						'parameter_type': LabelUtils.GetLabelFor(famParam.Definition.ParameterType),
						'parameter_formula': famParam.Formula,
						'is_instance': famParam.IsInstance,
						'is_shared': famParam.IsShared,
						'is_reporting': famParam.IsReporting,
						'display_units': LabelUtils.GetLabelFor(famParam.DisplayUnitType),
						
						'value': famType.AsDouble(famParam)
					})
					continue
				elif famParam.StorageType == StorageType.ElementId:
					tp.append(famType.AsElementId(famParam))
					famLib['families'][-1]['types'][-1]['parameters'].append({
						'parameter_name': famParam.Definition.Name,
						'parameter_group': LabelUtils.GetLabelFor(famParam.Definition.ParameterGroup),
						'parameter_type': LabelUtils.GetLabelFor(famParam.Definition.ParameterType),
						'parameter_formula': famParam.Formula,
						'is_instance': famParam.IsInstance,
						'is_shared': famParam.IsShared,
						'is_reporting': famParam.IsReporting,
						#'display_units': famParam.DisplayUnitType.ToString(),
						
						'value': famType.AsElementId(famParam).ToString()
					})
					continue
				elif famParam.StorageType == StorageType.Integer:
					tp.append(famType.AsInteger(famParam))
					famLib['families'][-1]['types'][-1]['parameters'].append({
						'parameter_name': famParam.Definition.Name,
						'parameter_group': LabelUtils.GetLabelFor(famParam.Definition.ParameterGroup),
						'parameter_type': LabelUtils.GetLabelFor(famParam.Definition.ParameterType),
						'parameter_formula': famParam.Formula,
						'is_instance': famParam.IsInstance,
						'is_shared': famParam.IsShared,
						'is_reporting': famParam.IsReporting,
						#'display_units': famParam.DisplayUnitType.ToString(),
						
						'value': famType.AsInteger(famParam)
					})
					continue
				elif famParam.StorageType == StorageType.String:
					tp.append(famType.AsString(famParam))
					famLib['families'][-1]['types'][-1]['parameters'].append({
						'parameter_name': famParam.Definition.Name,
						'parameter_group': LabelUtils.GetLabelFor(famParam.Definition.ParameterGroup),
						'parameter_type': LabelUtils.GetLabelFor(famParam.Definition.ParameterType),
						'parameter_formula': famParam.Formula,
						'is_instance': famParam.IsInstance,
						'is_shared': famParam.IsShared,
						'is_reporting': famParam.IsReporting,
						#'display_units': famParam.DisplayUnitType.ToString(),
						
						'value': famType.AsString(famParam)
					})
					continue
			famTypeParamValues.append(tp)
		
		paramValues.append(famTypeParamValues)		
		
		newFamPath = exportPath + "\\" + str(filenames)
		newdocpath.append(newFamPath)
		
		#newdoc.SaveAs(exportPath,SaveOptions)	
		newdoc.Close(False)
	#with open('D:\data.json', 'w') as outfile:
	with open(jsonexportPath + '\\family_data.json', 'w') as outfile:
		json.dump(famLib, outfile)
		
	OUT = [newdocpath, types, params, paramValues]
except Exception, e:
	OUT = str(e)
# ----------------------------------------
export_fbx_and_family_parameters_2 = Python(IN[0]=flatten, IN[1]=output_fbx_families, IN[2]=fileName, IN[3]=output_json)  # "EXPORT FBX AND FAMILY PARAMETERS ADD PARAM"; frozen
# ---------- export_fbx_and_family_parameters_2.python (231 lines) ----------
import clr
clr.AddReference('ProtoGeometry')
from Autodesk.DesignScript.Geometry import *

# Import RevitAPI
clr.AddReference("RevitAPI")
import Autodesk
from Autodesk.Revit.DB import *
from Autodesk.Revit.Attributes import*

clr.AddReference("RevitAPIUI")
from  Autodesk.Revit.UI import *

# Import DocumentManager and TransactionManager
clr.AddReference("RevitServices")
import RevitServices
from RevitServices.Persistence import DocumentManager
from RevitServices.Transactions import TransactionManager

from System.Collections.Generic import *

# Import Revit Nodes
clr.AddReference("RevitNodes")
import Revit
clr.ImportExtensions(Revit.Elements)
clr.ImportExtensions(Revit.GeometryConversion)

# Import python library
import sys
pyt_path = r'C:\Program Files (x86)\IronPython 2.7\Lib'
sys.path.append(pyt_path)
import os
import json

tOptions = TransactWithCentralOptions()

doc = DocumentManager.Instance.CurrentDBDocument
uiapp = DocumentManager.Instance.CurrentUIApplication
app = uiapp.Application
#uidoc = DocumentManager.Instance.CurrentUIApplication.ActiveUIDocument

if isinstance(IN[0], list):
	file = IN[0]
	filename = IN[2]
else:
	file = [IN[0]]
	filename = [IN[2]]

exportPath = IN[1]
jsonexportPath = IN[3]

newdocpath = []
types, params, paramValues = [], [], []

openConfig = WorksetConfiguration(WorksetConfigurationOption.OpenAllWorksets)
oOptions = OpenOptions()
oOptions.DetachFromCentralOption = DetachFromCentralOption.DetachAndDiscardWorksets
oOptions.Audit = False
oOptions.SetOpenWorksetsConfiguration(openConfig)

worksharingOptions = WorksharingSaveAsOptions()
worksharingOptions.SaveAsCentral = False

SaveOptions = SaveAsOptions()
SaveOptions.MaximumBackups = 1
SaveOptions.OverwriteExistingFile = True

famLib = {}
famLib['families'] = []

#TransactionManager.Instance.ForceCloseTransaction()

try:
	for files,filenames in zip(file,filename):
		modelpath = FilePath(files)
		newdoc = app.OpenDocumentFile(modelpath, oOptions)
	
		collector = Autodesk.Revit.DB.FilteredElementCollector(newdoc)
		docViews = collector.OfClass(Autodesk.Revit.DB.View3D).ToElements()
		
		viewIds = []
		for v in docViews:
			if v.CanBePrinted == True:
				viewIds.append(v.Id)
		
		##EXPORT FBX
		viewSetExport = ViewSet()
		viewSetExport.Insert(docViews[0])
		exportFBX = newdoc.Export(exportPath, newdoc.Title, viewSetExport, FBXExportOptions())
		
		##EXPORT DWG
		#viewListExport = List[Autodesk.Revit.DB.ElementId]()
		#viewListExport.Add(docViews[0].Id)
		#exportDWG = newdoc.Export(exportPath, newdoc.Title, viewListExport, DWGExportOptions())
		
		##EXPORT VIEWS AS IMAGES

		# image export options constructor
		ieo = ImageExportOptions()
		# export range (exporting amount of view(s))
		ieo.ExportRange = ExportRange.SetOfViews
		ieo.SetViewsAndSheets(viewIds)
		# filepath
		ieo.FilePath = exportPath + '\\' + newdoc.Title
		# File type for exported HLR and wireframe views
		ieo.HLRandWFViewsFileType = ImageFileType.PNG
		# image resolution
		ieo.ImageResolution = ImageResolution.DPI_300
		# fit direction
		ieo.FitDirection = FitDirectionType.Horizontal
		# pixelsize
		ieo.PixelSize = 600
		# file type for exported shadow views
		ieo.ShadowViewsFileType = ImageFileType.PNG
		# zoom type
		ieo.ZoomType = ZoomFitType.FitToPage
		# export image
		newdoc.ExportImage(ieo)
		
		famManager = newdoc.FamilyManager
		
		##ADD NEW PARAMETER
		newParameterName = "BIMMeet"
		newParameterType = ParameterType.Text
		newParameterGroup = BuiltInParameter.PG_DATA
		newParameterIsInstance = True
		newdoc.FamilyManager.AddParameter(newParameterName, newParameterGroup, newParameterIsInstance)
		
		famParams = newdoc.FamilyManager.GetParameters()
		params.append([p.Definition.Name for p in famParams])
		
		famTypes = newdoc.FamilyManager.Types
		types.append(famTypes)
		
		famTypeParamValues = []
		
		famLib['families'].append({
			'family_path': files,
			'family_name': newdoc.Title,
			'types': [],
			
		})		

		for famType in famTypes:
			tp = []
			famLib['families'][-1]['types'].append({
				'type_name': famType.Name,
				'parameters': [],
			})
			#fam = famLib['families'][-1]
			#fam['types'].append(famType.Name)
			
			for famParam in famParams:
				if famParam.StorageType == StorageType.Double:
					tp.append(famType.AsDouble(famParam))
					#famLib['families'][-1]['types'][-1]['parameters'][-1][famParam.Definition.Name] = famType.AsDouble(famParam)
					famLib['families'][-1]['types'][-1]['parameters'].append({
						'parameter_name': famParam.Definition.Name,
						'parameter_group': LabelUtils.GetLabelFor(famParam.Definition.ParameterGroup),
						'parameter_type': LabelUtils.GetLabelFor(famParam.Definition.ParameterType),
						'parameter_formula': famParam.Formula,
						'is_instance': famParam.IsInstance,
						'is_shared': famParam.IsShared,
						'is_reporting': famParam.IsReporting,
						'display_units': LabelUtils.GetLabelFor(famParam.DisplayUnitType),
						
						'value': famType.AsDouble(famParam)
					})
					continue
				elif famParam.StorageType == StorageType.ElementId:
					tp.append(famType.AsElementId(famParam))
					famLib['families'][-1]['types'][-1]['parameters'].append({
						'parameter_name': famParam.Definition.Name,
						'parameter_group': LabelUtils.GetLabelFor(famParam.Definition.ParameterGroup),
						'parameter_type': LabelUtils.GetLabelFor(famParam.Definition.ParameterType),
						'parameter_formula': famParam.Formula,
						'is_instance': famParam.IsInstance,
						'is_shared': famParam.IsShared,
						'is_reporting': famParam.IsReporting,
						#'display_units': famParam.DisplayUnitType.ToString(),
						
						'value': famType.AsElementId(famParam).ToString()
					})
					continue
				elif famParam.StorageType == StorageType.Integer:
					tp.append(famType.AsInteger(famParam))
					famLib['families'][-1]['types'][-1]['parameters'].append({
						'parameter_name': famParam.Definition.Name,
						'parameter_group': LabelUtils.GetLabelFor(famParam.Definition.ParameterGroup),
						'parameter_type': LabelUtils.GetLabelFor(famParam.Definition.ParameterType),
						'parameter_formula': famParam.Formula,
						'is_instance': famParam.IsInstance,
						'is_shared': famParam.IsShared,
						'is_reporting': famParam.IsReporting,
						#'display_units': famParam.DisplayUnitType.ToString(),
						
						'value': famType.AsInteger(famParam)
					})
					continue
				elif famParam.StorageType == StorageType.String:
					tp.append(famType.AsString(famParam))
					famLib['families'][-1]['types'][-1]['parameters'].append({
						'parameter_name': famParam.Definition.Name,
						'parameter_group': LabelUtils.GetLabelFor(famParam.Definition.ParameterGroup),
						'parameter_type': LabelUtils.GetLabelFor(famParam.Definition.ParameterType),
						'parameter_formula': famParam.Formula,
						'is_instance': famParam.IsInstance,
						'is_shared': famParam.IsShared,
						'is_reporting': famParam.IsReporting,
						#'display_units': famParam.DisplayUnitType.ToString(),
						
						'value': famType.AsString(famParam)
					})
					continue
			famTypeParamValues.append(tp)
		
		paramValues.append(famTypeParamValues)		
		
		newFamPath = exportPath + "\\" + str(filenames)
		newdocpath.append(newFamPath)
		
		##SAVE AS FAMILY IN NEW DIRECOTRY
		newdoc.SaveAs(exportPath,SaveOptions)	
		newdoc.Close(False)
	#with open('D:\data.json', 'w') as outfile:
	with open(jsonexportPath + '\\family_data.json', 'w') as outfile:
		json.dump(famLib, outfile)
		
	OUT = [newdocpath, types, params, paramValues]
except Exception, e:
	OUT = str(e)
# ----------------------------------------

watch = Watch(export_fbx_and_family_parameters)
code_block_3 = CodeBlock(f=fileName) { f[2]; }
